# Grasshopper definition ABG_191031_RhinoInside2.gh (Grasshopper 1.0.7)
# plug-ins: MeshEdit Components, RhinoInside.Revit

model = ModelCategoriesPicker({"Air Terminals": -2008013, "Cable Tray Fittings": -2008126, "Cable Trays": -2008130, "Casework": -2001000, "Ceilings": -2000038, "Columns": -2000100, "Communication Devices": -2008081, "Conduit Fittings": -2008128, "Conduits": -2008132, "Curtain Panels": -2000170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}, selected="Doors": -2000023)
ghpython_script = GhPythonScript()  # -> document, view
# ---------- ghpython_script: Python ----------
import clr
clr.AddReference('RhinoInside.Revit')
from RhinoInside.Revit import Revit, Convert
clr.AddReference('RevitAPI')
from Autodesk.Revit.DB import *
clr.AddReference('RevitAPIUI')

document = Revit.ActiveDBDocument
view = document.ActiveView
out = document
# ---------- end ghpython_script ----------
element_categoryfilter = ElementCategoryFilter(Categories=model, Inverted=False)
element_selectableinviewfilter = ElementSelectableInViewFilter(View=ghpython_script.view, Inverted=False)
element_logicalandfilter = ElementLogicalAndFilter(Filters=[element_categoryfilter, element_selectableinviewfilter])
document_elements = DocumentElements(Filter=element_logicalandfilter)
list_item = ListItem(List=document_elements, Index="0", Wrap=True)
ghpython_script_2 = GhPythonScript(element=document_elements)  # -> host
# ---------- ghpython_script_2: Python ----------
import clr
clr.AddReference('RhinoInside.Revit')
from RhinoInside.Revit import Revit, Convert
clr.AddReference('RevitAPI')
from Autodesk.Revit.DB import *
clr.AddReference('RevitAPIUI')

host = element.Host
# ---------- end ghpython_script_2 ----------
element_parameters = ElementParameters(Element=list_item)
element_identity = ElementIdentity(Element=ghpython_script_2)  # -> Category, Type, Name
element_identity_2 = ElementIdentity(Element=document_elements)  # -> Category, Type, Name
element_parameterget = ElementParameterGet(Element=element_identity.Type, ParameterKey="Fire Rating")
element_parameterget_2 = ElementParameterGet(Element=element_identity_2.Type, ParameterKey="Fire Rating")
expression = Expression(wall=element_parameterget, door=element_parameterget_2, Expression="wall=door")
dispatch = Dispatch(List=document_elements, DispatchPattern=expression)  # -> ListA, ListB
element_preview = ElementPreview(Element=dispatch.ListB)  # -> Meshes, Materials, Wires
mesh_join = MeshJoin(Meshes=element_preview.Meshes)
mesh_area = MeshArea(Mesh=mesh_join)  # -> Area, Centroid
circle_cnr = CircleCNR(Center=mesh_area.Centroid, Normal=Vector(0, 0, 1), Radius="2000")
surface = Surface(circle_cnr)
