# Grasshopper definition ABG_191104_RhinoInside3.gh (Grasshopper 1.0.7)
# plug-ins: MeshEdit Components, Bifocals, LunchBox, RhinoInside.Revit

model = ModelCategoriesPicker({"Air Terminals": -2008013, "Cable Tray Fittings": -2008126, "Cable Trays": -2008130, "Casework": -2001000, "Ceilings": -2000038, "Columns": -2000100, "Communication Devices": -2008081, "Conduit Fittings": -2008128, "Conduits": -2008132, "Curtain Panels": -2000170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}, selected="Curtain Panels")
elementtype_byname = ElementTypeByName(
    model,
    {"CRN_CTP_Apeture_Type1 : CRN_CTP_Apeture_Type1": 216424, "System Panel : Wall": 54539}, selected="CRN_CTP_Apeture_Type1 : CRN_CTP_Apeture_Type1")
element_typefilter = ElementTypeFilter(Types=elementtype_byname, Inverted=False)
document_elements = DocumentElements(Filter=element_typefilter)
element_preview = ElementPreview(Element=document_elements)  # -> Meshes, Materials, Wires
mesh_area = MeshArea(Mesh=element_preview.Meshes)  # -> Area, flatten(Centroid)
patch = Patch(Points=mesh_area.Centroid, Spans=20, Flexibility=1, Trim=True)
value_list = ValueList({"Normal": 0, "Invert": 1}, selected="Invert")
reverse_surface_direction = ReverseSurfaceDirection(Surface=patch, ReverseOption="2")
surface_closest_point = SurfaceClosestPoint(Point=mesh_area.Centroid, Surface=reparameterize(reverse_surface_direction))  # -> Point, UVPoint, Distance
deconstruct = Deconstruct(Point=surface_closest_point.UVPoint)  # -> XComponent, YComponent, ZComponent
bounds = Bounds(Numbers=deconstruct.XComponent)
bounds_2 = Bounds(Numbers=deconstruct.YComponent)
remap_numbers = RemapNumbers(Value=deconstruct.XComponent, Source=bounds, Target=Domain(0, 1))  # -> Mapped, Clipped
remap_numbers_2 = RemapNumbers(Value=deconstruct.YComponent, Source=bounds_2, Target=Domain(0, 1))  # -> Mapped, Clipped
construct_point = ConstructPoint(XCoordinate=remap_numbers.Mapped, YCoordinate=remap_numbers_2.Mapped, ZCoordinate=0)
image_sampler = ImageSampler(
    construct_point,
    FilePath="C:\Users\GavinC\Desktop\demo\ri3\test5.JPG",
    Filter="Value",
    Interpolate=False,
    Umax=1,
    Umin=0,
    Vmax=1,
    Vmin=0,
    Wrap=1)
subtraction = Subtraction(A=value_list, B=image_sampler)
absolute = Absolute(Value=subtraction)
stream_filter = StreamFilter(Gate=Button(), Stream1=document_elements)
element_parameterset = ElementParameterSet(Element=stream_filter, ParameterKey="Inset factor", ParameterValue=absolute)
