# Grasshopper definition ABG_191111_SunHours1.gh (Grasshopper 1.0.7)
# plug-ins: FalseStartToggle

# ---- group: Analysis Period Settings
number_slider = Slider(4, range=1..12)
number_slider_2 = Slider(6, range=1..12)
number_slider_3 = Slider(22, range=1..31)
analysisperiod = Ladybug_AnalysisPeriod(
    fromMonth=number_slider_2,
    fromDay=number_slider_3,
    fromHour=Slider(9, range=1..23),
    toMonth=number_slider_2,
    toDay=number_slider_3,
    toHour=Slider(15, range=1..23))  # -> readMe, analysisPeriod; plug-in component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

# ----
ladybug = Ladybug_Ladybug()  # -> Vviiiiiiiiiizzz; plug-in component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
epw_file_path = FilePath("D:\RH Rhino\AUS_NSW.Sydney.947670_IWEC.epw")
importepw = Ladybug_ImportEpw(epwFile=epw_file_path)  # -> readMe, latitude, location, dryBulbTemperature, dewPointTemperature, relativeHumidity, windSpeed, windDirection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; plug-in component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
sunpath = Ladybug_SunPath(
    location=importepw.location,
    hour=12,
    day=21,
    month=12,
    timeStep=number_slider,
    analysisPeriod=analysisperiod.analysisPeriod,
    dailyOrAnnualSunPath=True)  # -> readMe, sunVectors, sunAltitudes, sunAzimuths, port, sunSpheresMesh, sunPathCrvs, compassCrvs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; plug-in component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

# ---- group: Study settings
run = FalseStartToggle(True)
bake = FalseStartToggle(False)
number_slider_4 = Slider(0, range=0..360)
number_slider_5 = Slider(0.5, range=0..1)
number_slider_6 = Slider(3, range=0..500)
test = Brep(<brep referenced from the Rhino model>)
context = Mesh([<mesh referenced from the Rhino model> x207])
merge = Merge(Data1=test, Data2=context)

# ----
sunlighthoursanalysis = Ladybug_SunlightHoursAnalysis(
    north=number_slider_4,
    geometry=flatten(test),
    context=flatten(merge),
    gridSize=number_slider_6,
    disFromBase=number_slider_5,
    sunVectors=flatten(sunpath.sunVectors),
    timeStep=number_slider,
    runIt=run,
    bakeIt=bake)  # -> readMe, contextMesh, analysisMesh, flatten(testPts), testVec, port, flatten(sunlightHoursResult), sunlightHoursMesh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; plug-in component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

# ---- group: Find Z normal faces for dispatch
debrep = DeconstructBrep(Brep=test)  # -> Faces, Edges, Vertices
area = Area(Geometry=debrep.Faces)  # -> Area, Centroid
expression = Expression(x=number_slider_5, Expression="x*2")

# ----
evalsrf = EvaluateSurface(Surface=debrep.Faces, Point=area.Centroid)  # -> Point, Normal, UDirection, VDirection, Frame

# ---- group: Find Z normal faces for dispatch (continued)
devec = DeconstructVector(Vector=evalsrf.Normal)  # -> XComponent, YComponent, ZComponent
abs = Absolute(Value=devec.XComponent)
abs_2 = Absolute(Value=devec.YComponent)
abs_3 = Absolute(Value=devec.ZComponent)
expression_2 = Expression(x=abs, y=abs_2, z=abs_3, Expression="((2*x)+(2*y)+z)=1")
cull = CullPattern(List=debrep.Faces, CullPattern=expression_2)
mjoin = MeshJoin(Meshes=cull)
pull = PullPoint(Point=sunlighthoursanalysis.testPts, Geometry=mjoin, ClosestOnly=True)  # -> ClosestPoint, Distance
dist = Distance(PointA=sunlighthoursanalysis.testPts, PointB=pull.ClosestPoint)
smaller = SmallerThan(FirstNumber=expression, SecondNumber=dist)  # -> SmallerThan, OrEqualTo

# ---- group: Omitted points
dispatch = Dispatch(List=sunlighthoursanalysis.testPts, DispatchPattern=smaller.SmallerThan)  # -> ListA, ListB
preview = CustomPreview(Geometry=dispatch.ListB, Shader=ColourSwatch(SwatchColor=RGB(0, 0, 0)))

# ----
dispatch_2 = Dispatch(List=sunlighthoursanalysis.sunlightHoursResult, DispatchPattern=smaller.SmallerThan)  # -> ListA, ListB
round = Round(Number=dispatch_2.ListA)  # -> Nearest, Floor, Ceiling

# ---- group: Working out hours
sort = SortList(Keys=round.Floor)  # -> Keys, ValuesA
cset = CreateSet(List=sort.Keys)  # -> Set, Map
mindex = MemberIndex(Set=sort.Keys, Member=cset.Set)  # -> Index, Count
ma = MassAddition(Input=mindex.Count)  # -> Result, PartialResults
division = Division(A=mindex.Count, B=ma.Result)
round_2 = Round(Number=expr("x*100", division))  # -> Nearest, Floor, Ceiling
eval = Evaluate(F="Format(\"{0} hours: {1} {2}\", x, y,\"%\")", x=cset.Set, y=round_2.Nearest)

# ----
sun_hour_results = BarGraph(round.Floor, BarColor=RGB(255, 255, 255))
sun_hours_by = Panel(eval)
