# Grasshopper definition ABG_191125_RhinoInside4.gh (Grasshopper 1.0.7)
# plug-ins: RhinoInside.Revit

grid_extension = Slider(3000, range=3000..15000)
h_spacing = Slider(7496, range=3000..15000)
h_count = Slider(7, range=2..15)
v_count = Slider(5, range=2..15)
v_spacing = Slider(5267, range=3000..15000)
construct_point = ConstructPoint(XCoordinate=0, YCoordinate=0, ZCoordinate=0)
circle_cnr = CircleCNR(Center=construct_point, Normal=Vector(0, 0, 1), Radius="1000")
expression = Expression(H_Sp=h_spacing, H_No=h_count, Offset=grid_extension, Expression="(2*Offset)+(H_Sp*(H_No-1))")
expression_2 = Expression(V_Sp=v_spacing, V_No=v_count, Offset=grid_extension, Expression="((2*Offset)+(V_Sp*(V_No-1)))*-1")
unit_y = UnitY(Factor=grid_extension)
unit_x = UnitX(Factor=grid_extension)
reverse = Reverse(Vector=unit_x)
move = Move(Geometry=construct_point, Motion=reverse)  # -> Geometry, Transform
unit_x_2 = UnitX(Factor=expression)
move_2 = Move(Geometry=construct_point, Motion=unit_y)  # -> Geometry, Transform
unit_y_2 = UnitY(Factor=expression_2)
move_3 = Move(Geometry=move.Geometry, Motion=unit_x_2)  # -> Geometry, Transform
move_4 = Move(Geometry=move_2.Geometry, Motion=unit_y_2)  # -> Geometry, Transform
unit_y_3 = UnitY(Factor=v_spacing)
unit_x_3 = UnitX(Factor=h_spacing)
line = Line(StartPoint=move.Geometry, EndPoint=move_3.Geometry)
line_2 = Line(StartPoint=move_2.Geometry, EndPoint=move_4.Geometry)
reverse_2 = Reverse(Vector=unit_y_3)
construct_domain = ConstructDomain(DomainStart=1, DomainEnd=v_count)
subtraction = Subtraction(A=v_count, B=1)
linear_array = LinearArray(Geometry=line, Direction=reverse_2, Count=v_count)  # -> Geometry, Transform
linear_array_2 = LinearArray(Geometry=line_2, Direction=unit_x_3, Count=h_count)  # -> Geometry, Transform
range = Range(Domain=construct_domain, Steps=subtraction)
char_sequence = CharSequence(Count=h_count, CharPool="ABCDEFGHIJKLMNOPQRSTUVWXYZ", Format="{0}")
round = Round(Number=range)  # -> Nearest, Floor, Ceiling
create_grids = Button()
merge = Merge(Data1=linear_array.Geometry, Data2=linear_array_2.Geometry)  # -> flatten(Result)
merge_2 = Merge(Data1=round.Nearest, Data2=char_sequence)  # -> flatten(Result)
grid = Grid(<grid referenced from the Revit model>)
model = ModelCategoriesPicker({"Air Terminals": -2008013, "Cable Tray Fittings": -2008126, "Cable Trays": -2008130, "Casework": -2001000, "Ceilings": -2000038, "Columns": -2000100, "Communication Devices": -2008081, "Conduit Fittings": -2008128, "Conduits": -2008132, "Curtain Panels": -2000170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}, selected="Structural Columns": -2001330)
element_identity = ElementIdentity(Element=grid)  # -> Category, Type, Name
stream_filter = StreamFilter(Gate=create_grids, Stream1=merge)
merge_3 = Merge(Data1=linear_array.Geometry, Data2=linear_array_2.Geometry)  # -> flatten(Result)
addgrid_bycurve = AddGridByCurve(Curve=stream_filter, Type=element_identity.Type, Name=merge_2)
elementtype_byname = ElementTypeByName(model, {"UC-Universal Columns-Column : UC305x305x97": 212714}, selected="UC-Universal Columns-Column : UC305x305x97")
create_columns = Button()
multiple_curves = MultipleCurves(Curves=merge_3)  # -> Points, IndexA, IndexB, ParamA, ParamB
level = DocumentLevelsPicker({"Level 1": 694, "Ground Floor": 311}, selected=["Level 1", "Ground Floor"])
stream_filter_2 = StreamFilter(Gate=create_columns, Stream1=multiple_curves.Points)  # -> graft(Stream)
addfamilyinstance_bylocation = AddFamilyInstanceByLocation(Location=stream_filter_2, Type=elementtype_byname, Level=level)
