# Grasshopper definition ABG_191128_RhinoInside5.gh (Grasshopper 1.0.7)
# plug-ins: RhinoInside.Revit

up_to_level_number = Slider(6, range=2..15)
podium_number = Slider(1, range=1..3)
typical_height = Slider(2700, range=2400..5000)
podium_height = Slider(5000, range=2700..8000)
level = DocumentLevelsPicker({"Ground Floor": 311}, selected="Ground Floor")
construct_domain = ConstructDomain(DomainStart=podium_number, DomainEnd=up_to_level_number)
element_parameterget = ElementParameterGet(Element=level, ParameterKey="Elevation")
subtraction = Subtraction(A=up_to_level_number, B=podium_number)
range = Range(Domain=construct_domain, Steps=subtraction)
panel = Panel(element_parameterget)
multiplication = Multiplication(A=subtraction, B=typical_height)
round = Round(Number=range)  # -> Nearest, Floor, Ceiling
addition = Addition(A=podium_height, B=panel)
concatenate = Concatenate(FragmentA="Level", FragmentB=" ", FragmentA_2=round.Nearest)
addition_2 = Addition(A=multiplication, B=addition)
construct_domain_2 = ConstructDomain(DomainStart=addition, DomainEnd=addition_2)
range_2 = Range(Domain=construct_domain_2, Steps=subtraction)
round_2 = Round(Number=range_2)  # -> Nearest, Floor, Ceiling
panel_2 = Panel(concatenate)
panel_3 = Panel(round_2.Nearest)
element_identity = ElementIdentity(Element=level)  # -> Category, Type, Name
create_levels = Button()
elementtype_byname = ElementTypeByName(element_identity.Category, {"Level : 8mm Head": 305}, selected="Level : 8mm Head")
stream_filter = StreamFilter(Gate=create_levels, Stream1=panel_3)
addlevel_byelevation = AddLevelByElevation(Elevation=stream_filter, Type=elementtype_byname, Name=panel_2)
