# Grasshopper definition ABG_191205_Anenome2.gh (Grasshopper 1.0.7)
# plug-ins: Anemone

loop_start = LoopStart(Repeat=Slider(1000, range=0..1000), Trigger=Button(), Data="0", Radius="10")  # -> port, Counter, Data, Radius
panel = Panel(loop_start.Counter)
addition = Addition(A=loop_start.Data, B=Slider(0.01, range=0.001..0.01))
addition_2 = Addition(A=loop_start.Radius, B="2")
curve = Curve(<curve referenced from the Rhino model>)
larger_than = LargerThan(FirstNumber=addition, SecondNumber="1")  # -> LargerThan, OrEqualTo
evaluate_curve = EvaluateCurve(Curve=reparameterize(curve), Parameter=addition)  # -> Point, Tangent, Angle
loop_end = LoopEnd(
    port=loop_start.port,
    Exit=larger_than.LargerThan,
    Data=addition,
    Radius=addition_2,
    TimeOutVal=0,
    pausedState=False,
    state="Constant & Record")  # -> Data, D1
circle_cnr = CircleCNR(Center=evaluate_curve.Point, Normal=Vector(0, 0, 1), Radius=addition_2)
