# Grasshopper definition ABG_191205_Anenome5.gh (Grasshopper 1.0.7)
# plug-ins: Anemone, FalseStartToggle

loop_start = LoopStart(Repeat=Slider(1000, range=0..1000), Trigger=Button(), Data="0", Radius="10")  # -> port, Counter, Data, Radius, Circle
pause = FalseStartToggle(False)
# none = 0
# slow = 1
# fast = 2
# decay = negative
panel = Panel(loop_start.Counter)
addition = Addition(A=loop_start.Data, B=Slider(0.01, range=0.001..0.01))
curve = Curve(<curve referenced from the Rhino model>)
value_list = ValueList({"None": 0, "Slow growth": 1, "Fast growth": 2, "Slow decay": -1, "Fsst decay": -2}, selected="Slow decay")
stream_filter = StreamFilter(Gate=pause, Stream0=curve)
addition_2 = Addition(A=loop_start.Radius, B=value_list)
larger_than = LargerThan(FirstNumber=addition, SecondNumber="1")  # -> LargerThan, OrEqualTo
evaluate_curve = EvaluateCurve(Curve=reparameterize(stream_filter), Parameter=addition)  # -> Point, Tangent, Angle
smaller_than = SmallerThan(FirstNumber=addition_2, SecondNumber="0")  # -> SmallerThan, OrEqualTo
stream_filter_2 = StreamFilter(Gate=smaller_than.OrEqualTo, Stream0=addition_2, Stream1="0")
stream_filter_3 = StreamFilter(Gate=larger_than.LargerThan, Stream0=addition, Stream1="0")
circle_cnr = CircleCNR(Center=evaluate_curve.Point, Normal=Vector(0, 0, 1), Radius=stream_filter_2)
loop_end = LoopEnd(
    port=loop_start.port,
    Exit=False,
    Data=stream_filter_3,
    Radius=stream_filter_2,
    Circle=circle_cnr,
    TimeOutVal=0,
    pausedState=False,
    state="Constant output")  # -> Data, D1, Circles
list_length = ListLength(List=flatten(loop_end.Circles))
panel_2 = Panel(list_length)
