# Grasshopper definition ABG_191209_ImageSampling.gh (Grasshopper 0.9.76)
# plug-ins: Bifocals

number_slider = Slider(45, range=0..500)
number_slider_2 = Slider(60, range=0..500)
number_slider_3 = Slider(15, range=0..100)
construct_point = ConstructPoint(XCoordinate=0, YCoordinate=0, ZCoordinate=0)
rectangle = Rectangle(Plane=construct_point, XSize=number_slider_3, YSize=number_slider_3, Radius=0)  # -> Rectangle, Length
rectangular_array = RectangularArray(Geometry=construct_point, Cell=rectangle.Rectangle, XCount=number_slider, YCount=number_slider_2)  # -> Geometry, Transform
bounding_box = BoundingBox(Content=rectangular_array.Geometry, Plane=PlaneXY(0, 0, 0), UnionBox=True)  # -> Box, Box_2
image_sampler = ImageSampler(
    FilePath="C:\Users\GavinC\Desktop\demo\image sampler\687px-Mona_Lisa,_by_Leonardo_da_Vinci,_from_C2RMF_retouched.jpg",
    Filter="Colour",
    Interpolate=False,
    Umax=1,
    Umin=0,
    Vmax=1,
    Vmin=0,
    Wrap=1)
surface_closest_point = SurfaceClosestPoint(Point=rectangular_array.Geometry, Surface=reparameterize(bounding_box.Box_2))  # -> Point, UVPoint, Distance
rectangle_2 = Rectangle(Plane=rectangular_array.Geometry, XSize=number_slider_3, YSize=number_slider_3, Radius=0)  # -> Rectangle, Length
image_sampler_2 = ImageSampler(
    FilePath="C:\Users\GavinC\Desktop\demo\image sampler\b4b2b152f6ca619525d7235cb802ca8a.jpg",
    Filter="Value",
    Interpolate=False,
    Umax=1,
    Umin=0,
    Vmax=1,
    Vmin=0,
    Wrap=1)
value_list = ValueList({"Invert": 0, "Standard": 1}, selected="Standard")
image_sampler_3 = ImageSampler(
    surface_closest_point.UVPoint,
    FilePath="C:\Users\GavinC\Desktop\demo\image sampler\b4b2b152f6ca619525d7235cb802ca8a.jpg",
    Filter="Value",
    Interpolate=False,
    Umax=1,
    Umin=0,
    Vmax=1,
    Vmin=0,
    Wrap=1)
image_sampler_4 = ImageSampler(
    surface_closest_point.UVPoint,
    FilePath="C:\Users\GavinC\Desktop\demo\image sampler\687px-Mona_Lisa,_by_Leonardo_da_Vinci,_from_C2RMF_retouched.jpg",
    Filter="Colour",
    Interpolate=False,
    Umax=1,
    Umin=0,
    Vmax=1,
    Vmin=0,
    Wrap=1)
construct_domain = ConstructDomain(DomainStart=Slider(152, range=0..500), DomainEnd=Slider(0, range=0..500))
expression = Expression(x=image_sampler_3, y=value_list, Expression="abs(y-x)")
remap_numbers = RemapNumbers(Value=expression, Source=Domain(0, 1), Target=construct_domain)  # -> Mapped, Clipped

# ---- group: Unused
unit_z = UnitZ(Factor=remap_numbers.Mapped)  # disabled
gradient = Gradient(LowerLimit=0, UpperLimit=1, Parameter=expression, stops=[0: RGB(255, 255, 255), 1: RGB(0, 0, 0)])  # disabled
move = Move(Geometry=rectangular_array.Geometry, Motion=unit_z)  # -> Geometry, Transform; disabled
surface_from_points = SurfaceFromPoints(Points=move.Geometry, UCount=number_slider_2, Interpolate=False)  # disabled

# ----
deconstruct = Deconstruct(Point=rectangular_array.Geometry)  # -> XComponent, YComponent, ZComponent; disabled
construct_point_2 = ConstructPoint(XCoordinate=deconstruct.XComponent, YCoordinate=deconstruct.YComponent, ZCoordinate=remap_numbers.Mapped)
surface_from_points_2 = SurfaceFromPoints(Points=construct_point_2, UCount=number_slider_2, Interpolate=False)
divide_domain² = DivideDomain²(Domain=surface_from_points_2, UCount=number_slider_2, VCount=number_slider)
isotrim = Isotrim(Surface=surface_from_points_2, Domain=divide_domain²)

box_rectangle = BoxRectangle(Rectangle=rectangle_2.Rectangle, Height=remap_numbers.Mapped)
circle = Circle(Plane=rectangular_array.Geometry, Radius=remap_numbers.Mapped)  # disabled
custom_preview = CustomPreview(Geometry=box_rectangle, Shader=image_sampler_4)
