# Grasshopper definition ABG_200123_FlipPanelFacade.gh (Grasshopper 1.0.7)
# plug-ins: Bifocals

number_slider = Slider(1000, range=1000..5000)
rectangle = Rectangle(Plane=PlaneXY(0, 0, 0), XSize=number_slider, YSize=number_slider, Radius=0)  # -> Rectangle, Length
yz_plane = YZPlane(Origin=Point(0, 0, 0))
colourised = BooleanToggle(False)
number_slider_2 = Slider(30, range=0..100)
rotate = Rotate(Geometry=rectangle.Rectangle, Angle=degrees("90"), Plane=yz_plane)  # -> Geometry, Transform
rectangular_array = RectangularArray(Geometry=rotate.Geometry, Cell=rotate.Geometry, XCount=number_slider_2, YCount=number_slider_2)  # -> Geometry, Transform
area = Area(Geometry=rectangular_array.Geometry)  # -> Area, Centroid
bounding_box = BoundingBox(Content=rectangular_array.Geometry, Plane=PlaneXY(0, 0, 0), UnionBox=True)  # -> Box, Box_2
surface = Surface(bounding_box.Box)
surface_closest_point = SurfaceClosestPoint(Point=area.Centroid, Surface=reparameterize(surface))  # -> Point, UVPoint, Distance
image_sampler = ImageSampler(
    surface_closest_point.UVPoint,
    FilePath="C:\Users\GavinC\Desktop\demo\flip panels\Capture.PNG",
    Filter="Value",
    Interpolate=False,
    Umax=1,
    Umin=0,
    Vmax=1,
    Vmin=0,
    Wrap=1)
construct_domain = ConstructDomain(DomainStart="-45", DomainEnd="45")
remap_numbers = RemapNumbers(Value=image_sampler, Source=Domain(0, 1), Target=construct_domain)  # -> Mapped, Clipped
addition = Addition(A=remap_numbers.Mapped, B=Slider(244, range=0..360))
rotate_2 = Rotate(Geometry=rectangular_array.Geometry, Angle=degrees(addition), Plane=area.Centroid)  # -> Geometry, Transform
bounds = Bounds(Numbers=addition)
surface_2 = Surface(rotate_2.Geometry)
remap_numbers_2 = RemapNumbers(Value=addition, Source=bounds, Target=Domain(0, 1))  # -> Mapped, Clipped
gradient = Gradient(
    LowerLimit=0,
    UpperLimit=1,
    Parameter=remap_numbers_2.Mapped,
    stops=[0: RGB(234, 38, 0), 0.25: RGB(234, 126, 0), 0.5: RGB(254, 244, 84), 0.75: RGB(173, 203, 249), 1: RGB(75, 107, 169)])
stream_filter = StreamFilter(Gate=colourised, Stream0=ColourSwatch(SwatchColor=RGB(125, 125, 125)), Stream1=gradient)
custom_preview = CustomPreview(Geometry=surface_2, Material=stream_filter)
