# Grasshopper definition ABG_200611_GenDesignRhino.gh (Grasshopper 1.0.7)
# plug-ins: Rhino.Inside for Autodesk Revit, Bifocals

genes = GenePool(Decimals=4, Maximum=100, Minimum=0, Value=[0.4401, 19.0929, 66.5752])

# ---- group: Property lines
property_line = GraphicalElement(<graphical element referenced from the Revit model>)
geometry = ElementGeometry(Element=property_line)
join = JoinCurves(Curves=geometry, Preserve=False)

# ----
x_y_size_range = Panel("20000 to 50000")

# ---- group: Build starting values
item = ListItem(List=genes, Index="0", Wrap=True)
item_2 = ListItem(List=genes, Index="1", Wrap=True)
item_3 = ListItem(List=genes, Index="2", Wrap=True)
division = Division(A=item_3, B="100")
division_2 = Division(A=item_2, B="100")
remap = RemapNumbers(Value=item, Source="0 to 100", Target=x_y_size_range)  # -> Mapped, Clipped
pt = ConstructPoint(XCoordinate=division_2, YCoordinate=division, ZCoordinate=0)
division_3 = Division(A=remap.Mapped, B="2")

# ----
maximum_control = Panel("50000000")

# ---- group: Height
multiplication = Multiplication(A=remap.Mapped, B=remap.Mapped)
division_4 = Division(A=multiplication, B="1000000")
division_5 = Division(A=maximum_control, B=division_4)

# ---- group: Point on site
offset = OffsetCurve(Curve=join, Distance=division_3, Plane=PlaneXY(0, 0, 0), Corners=1)
srf = Surface(offset)
evalsrf = EvaluateSurface(Surface=reparameterize(srf), Point=pt)  # -> Point, Normal, UDirection, VDirection, Frame

# ----
preview = CustomPreview(Geometry=[offset, join], Material=ColourSwatch(SwatchColor=RGB(255, 0, 0)))

dom = ConstructDomain(DomainStart=division_3, DomainEnd=expr("x*-1", division_3))

# ---- group: Building mass
rectangle = Rectangle(Plane=evalsrf.Point, XSize=dom, YSize=dom, Radius=0)  # -> Rectangle, Length
Z = UnitZ(Factor=division_5)
extr = Extrude(Base=rectangle.Rectangle, Direction=Z)
cap = CapHoles(Brep=extr)

# ----
f2f = Panel("3500")

# ---- group: Find test height points
division_6 = Division(A=division_5, B=f2f)
round = Round(Number=division_6)  # -> Nearest, Floor, Ceiling
multiplication_2 = Multiplication(A=f2f, B=round.Floor)
dom_2 = ConstructDomain(DomainStart="0", DomainEnd=multiplication_2)
range = Range(Domain=dom_2, Steps=round.Floor)
Z_2 = UnitZ(Factor=range)

# ----
preview_2 = CustomPreview(Geometry=cap, Material=ColourSwatch(SwatchColor=RGB(0, 255, 109)))

move = Move(Geometry=evalsrf.Point, Motion=Z_2)  # -> Geometry, Transform

# ---- group: Vectors for testing
range_2 = Range(Domain="0 to 350", Steps="35")
Y = UnitY(Factor=1)
Z_3 = UnitZ(Factor=1)
vrot = Rotate(Vector=Y, Axis=Z_3, Angle=range_2)

# ----
context = GraphicalElement(<graphical element referenced from the Revit model>)

# ---- group: Site geometry
geometry_2 = ElementGeometry(Element=context)
mesh = Mesh(geometry_2)
preview_3 = CustomPreview(Geometry=geometry_2, Material=ColourSwatch(SwatchColor=RGB(0, 156, 255)))
mjoin = MeshJoin(Meshes=mesh)

# ----
line = LineSDL(Start=graft(move.Geometry), Direction=vrot, Length="300000")

meshray = MeshRay(Mesh=mjoin, Point=graft(move.Geometry), Direction=vrot)  # -> Point, Hit
not = GateNot(A=meshray.Hit)

cull = CullPattern(List=line, CullPattern=not)
lng = ListLength(List=cull)  # -> flatten(Length)
ma = MassAddition(Input=lng)  # -> Result, PartialResults

num = Number(ma.Result)
number_of_views = Panel(ma.Result)
galapagos = Galapagos(fitness=num, gene=genes)
