# Grasshopper definition ABG_201022_LloydsAlgorithm.gh (Grasshopper 1.0.7)
# plug-ins: Anemone, FalseStartToggle, Bifocals

crv = Curve(<curve referenced from the Rhino model>)
end = EndPoints(Curve=crv)  # -> Start, End
ln = Line(StartPoint=end.Start, EndPoint=end.End)
merge = Merge(Data1=ln, Data2=crv)
join = JoinCurves(Curves=merge, Preserve=False)
bbox = BoundingBox(Content=join, Plane=PlaneXY(0, 0, 0))  # -> Box, Box_2
srf = Surface(join)
pop2d = Populate2D(Region=bbox.Box, Count=Slider(100, range=1..100), Seed=1)
voronoi = Voronoi(Points=pop2d, Boundary=bbox.Box, BruteForceOverride=False)
loop_start = LoopStart(Repeat=Slider(100, range=1..100), Trigger=Button(), Data=voronoi)  # -> port, Counter, Data
area = Area(Geometry=loop_start.Data)  # -> Area, Centroid
voronoi_2 = Voronoi(Points=area.Centroid, Boundary=bbox.Box, BruteForceOverride=False)
toggle = FalseStartToggle(False)
loop_end = LoopEnd(port=loop_start.port, Exit=toggle, Data=voronoi_2, TimeOutVal=0, pausedState=False, state="Constant output")
area_2 = Area(Geometry=loop_end)  # -> Area, Centroid
srf_cp = SurfaceClosestPoint(Point=area_2.Centroid, Surface=srf)  # -> Point, UVPoint, Distance
smaller = SmallerThan(FirstNumber=srf_cp.Distance, SecondNumber="1")  # -> SmallerThan, OrEqualTo
cull = CullPattern(List=loop_end, CullPattern=smaller.SmallerThan)
cull_2 = CullPattern(List=area_2.Centroid, CullPattern=smaller.SmallerThan)
