# Grasshopper definition ABG_201119_RhinoShade.gh (Grasshopper 1.0.7)
# plug-ins: Kangaroo2 Components, LunchBox, Rhino.Inside for Autodesk Revit, Bifocals

model = ModelCategoriesPicker({"Air Systems": -2001008, "Air Terminals": -2008013, "Analysis Display Style": -2000304, "Analysis Results": -2000303, "Areas": -2003200, "Bridge Abutments": -2006130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}, selected="Generic Models": -2000151)
elementtype_picker = ElementTypePicker(
    model,
    {"Adaptive shade : Adaptive shade": 237834, "Anchor : Anchor": 239008, "Generic Models 1 : Generic Models 1": 217498, "Generic Models 2 : Generic Models 1": 217522, "Generic Models 3 : Generic Models 1": 217546, "Generic Models 4 : Generic Models 1": 219215, "Model Text : 600mm Arial": 7848, "Rod final : Rod final": 236229, "Shade final : Shade final": 236253}, selected="Anchor : Anchor")
bytype = TypeFilter(Types=elementtype_picker, Inverted=False)
elements = DocumentElements(Filter=bytype)
geometry = ElementGeometry(Elements=elements)
area = Area(Geometry=flatten(geometry))  # -> Area, Centroid
srf = Surface(<surface referenced from the Rhino model>)
bool = Boolean(True)
pline = PolyLine(Vertices=area.Centroid, Closed=bool)
mesh = Mesh(srf)
srf_2 = Surface(pline)

mc = MeshCorners(Mesh=mesh, Angle=2.35619449)
anchor = Anchor(Point=mc, Strength=10000)

edgelengths = EdgeLengths(Mesh=mesh, LengthFactor=Slider(0.7, range=0..1), Strength=1)
vertexloads = VertexLoads(Mesh=mesh, Strength=Slider(-2.83, range=-5..5))
area_2 = Area(Geometry=srf)  # -> Area, Centroid
show = Show(G=mesh)
pt = ConstructPoint(XCoordinate="0.5", YCoordinate="0.5", ZCoordinate=0)
evalsrf = EvaluateSurface(Surface=reparameterize(srf), Point=pt)  # -> Point, Normal, UDirection, VDirection, Frame
solver = Solver(GoalObjects=[anchor, edgelengths, show, vertexloads], Reset=Button(), Threshold=1e-15, Tolerance=0.01, On=Toggle(False))  # -> I, V, O
line = LineSDL(Start=area_2.Centroid, Direction=evalsrf.Normal, Length="-5000")
item = ListItem(List=flatten(solver.O), Index=0, Wrap=True)
mshedge = MeshEdgesWithTolerance(Mesh=item, AngleThreshold=45)  # -> InteriorEdges, NakedEdges
mcx = MeshCurve(Mesh=item, Curve=line)  # -> Points, Faces
mc_2 = MeshCorners(Mesh=item, Angle=2.35619449)
join = JoinCurves(Curves=mshedge.NakedEdges, Preserve=False)
crv_cp = CurveClosestPoint(Point=mc_2, Curve=join)  # -> Point, Parameter, Distance
model_2 = ModelCategoriesPicker({"Air Systems": -2001008, "Air Terminals": -2008013, "Analysis Display Style": -2000304, "Analysis Results": -2000303, "Areas": -2003200, "Bridge Abutments": -2006130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}, selected="Generic Models": -2000151)
shatter = Shatter(Curve=join, Parameters=crv_cp.Parameter)
curvepoint = PointOnCurve(shatter, parameter=0.5)
curvepoint_2 = PointOnCurve(shatter, parameter=0)
elementtype_picker_2 = ElementTypePicker(
    model_2,
    {"Adaptive shade : Adaptive shade": 237834, "Anchor : Anchor": 239008, "Generic Models 1 : Generic Models 1": 217498, "Generic Models 2 : Generic Models 1": 217522, "Generic Models 3 : Generic Models 1": 217546, "Generic Models 4 : Generic Models 1": 219215, "Model Text : 600mm Arial": 7848, "Rod final : Rod final": 236229, "Shade final : Shade final": 236253}, selected="Adaptive shade : Adaptive shade")
merge = Merge(Data1=graft(curvepoint_2), Data2=graft(curvepoint))  # -> flatten(Result)
merge_2 = Merge(Data1=merge, Data2=mcx.Points)  # -> flatten(Result)
filter = StreamFilter(Gate=Button(), Stream1=elementtype_picker_2)
adapcomp = AddAdaptiveComponent(Points=merge_2, Type=filter)
