# Grasshopper definition ABG_201130_RevitToRhino1.gh (Grasshopper 1.0.7)
# plug-ins: Bifocals, EleFront, Rhino.Inside for Autodesk Revit, FalseStartToggle, LunchBox

_1_rename_geometry = Button()
_2_send_geometry = FalseStartToggle(True)
_6_add_materials = Button()
_4_assign_layers = Button()
_3_make_layers = Button()
_5_send_data = Button()
_0_collect_meshes = Mesh([<mesh referenced from the Rhino model> x1353])

rhatt = GetRhinoAttributes(Geometry=_0_collect_meshes)  # -> Name, Layer, Color
len = TextLength(Text=rhatt.Name)
subtraction = Subtraction(A=len, B="8")
fragment = TextFragment(Text=rhatt.Name, Start=subtraction, Count="7")
attributes = DefineObjectAttributes(Name=fragment)
modifyatt = ModifyRhinoObjectAttributes(Geometry=_0_collect_meshes, Attributes=attributes, Modify=_1_rename_geometry)

filter = StreamFilter(Gate=_2_send_geometry, Stream1=_0_collect_meshes)
rhatt_2 = GetRhinoAttributes(Geometry=filter)  # -> Name, Layer, Color
agraphview = ActiveGraphicalView()
selfltr = SelectableInViewFilter(View=agraphview, Inverted=False)
elements = QueryElements(Filter=selfltr)  # -> Elements, Count
getpara = GetElementParameter(Element=elements.Elements, ParameterKey="Id")
fsim = FindSimilarMember(Data=rhatt_2.Name, Set=getpara)  # -> Hit, Index
elemcat = ElementCategory(Element=elements.Elements)  # -> Element, Category
item = ListItem(List=elemcat.Category, Index=fsim.Index, Wrap=True)

identity = CategoryIdentity(Category=item)  # -> Type, Parent, Name, AllowsSubcategories, AllowsParameters, HasMaterialQuantities, Cuttable
cset = CreateSet(List=identity.Name)  # -> Set, Map
lng = ListLength(List=cset.Set)  # -> expr("x-1", Length)
range = Range(Domain=Domain(0, 1), Steps=lng)
gradient = Gradient(
    LowerLimit=0,
    UpperLimit=1,
    Parameter=range,
    stops=[0: RGB(243, 57, 0), 0: RGB(17, 157, 129), 0.1: RGB(236, 27, 60), 0.2: RGB(210, 0, 118), 0.3: RGB(103, 0, 120), 0.4: RGB(39, 72, 161), 0.5: RGB(1, 192, 229), 0.6: RGB(18, 178, 90), 0.7: RGB(79, 186, 8), 0.8: RGB(220, 237, 32), 0.9: RGB(247, 159, 20), 1: RGB(243, 57, 0)])
layer = CreateLayers(CreateToggle=_3_make_layers, LayerNames=cset.Set, LayerColors=gradient)

item_2 = ListItem(List=elements.Elements, Index=fsim.Index, Wrap=True)
elemtype = ElementType(Element=item_2)  # -> Element, Type
typident = TypeIdentity(Type=elemtype.Type)  # -> Category, FamilyName, Name
txt = Text(typident.FamilyName)
txt_2 = Text(typident.Category)
txt_3 = Text(typident.Name)
merge = Merge(Data1=graft(txt_2), Data2=graft(txt), Data3=graft(txt_3), Data4=graft(fsim.Hit))

materials = ElementMaterials(Element=item_2)  # -> Materials, Paint
identity_2 = MaterialIdentity(Material=materials.Materials)  # -> Name, Description, Class, Comments, Manufacturer, Model, Cost, URL, Keynote, Mark
flip = FlipMatrix(Data=identity_2.Name)
flip_2 = FlipMatrix(Data=flip)

panel = Panel("""Material 1
Material 2
Material 3""")
panel_2 = Panel("""Category
Family
Type
Id""")
attributes_2 = DefineObjectAttributes(UserKeys=panel, UserValues=flip_2)  # -> flatten(Attributes)
attributes_3 = DefineObjectAttributes(UserKeys=panel_2, UserValues=merge)  # -> flatten(Attributes)
attributes_4 = DefineObjectAttributes(Layer=identity.Name)
modifyatt_2 = ModifyRhinoObjectAttributes(Geometry=_0_collect_meshes, Attributes=attributes_4, Modify=_4_assign_layers)
modifyatt_3 = ModifyRhinoObjectAttributes(Geometry=_0_collect_meshes, Attributes=attributes_3, Modify=_5_send_data)
modifyatt_4 = ModifyRhinoObjectAttributes(Geometry=_0_collect_meshes, Attributes=attributes_2, Modify=_6_add_materials)
