# Grasshopper definition ABG_201203_RevitToRhino2.gh (Grasshopper 1.0.7)
# plug-ins: LunchBox, EleFront, Human, Bifocals

layer_info = LayerInformation(ReferenceToggle=Toggle(True))  # -> Names, DisplayColors, GUID
list = ItemSelector(
    layer_info.Names,
    {"Casework", "Ceilings", "Curtain Panels", "Curtain Wall Mullions", "Default", "Doors", "Fascias", "Floors", "Furniture", "Generic Models", "Gutters", "Levels", "Lighting Fixtures", "Mechanical Equipment", "Pads", "Planting", "Plumbing Fixtures", "Railings", "Roofs", "Runs", "Site", "Specialty Equipment", "Stairs", "Structural Columns", "Structural Foundations", "Structural Framing", "Topography", "Wall Sweeps", "Walls", "Windows"}, selected="Floors")
concat = Concatenate(FragmentA="Revit Category : ", FragmentB=list)
refua = ReferenceByUserAtributes(Key="Category", Val=concat)  # -> flatten(Geometry)
list_2 = ValueList({"FCP - Carpet on Joists, 250mm", "FCP - Carpet, 15mm", "FIC - Concrete, 200mm", "FIC - Concrete, 250mm", "FTB - Timber on Joists, 20/200", "FTB - Timber, 15mm", "FTL - Floor Tiles, 10mm (300x300)", "FTL - Floor Tiles, 10mm (600x600)", "FTL - Floor Tiles, 40mm (300x300)", "FTL - Floor Tiles,50mm (600x600)", "NOSCHED - Bath Font, 30mm", "NOSCHED - Driveway", "NOSCHED - Grass", "NOSCHED - Water"}, selected="FCP - Carpet, 15mm")
list_3 = ValueList({"Category", "Family", "Id", "Material 1", "Material 2", "Material 3", "Type"}, selected="Type")
filteratt = FilterByUserAttributes(Attributes=refua, Key=list_3, Val=list_2)  # -> G, Key, Val
id = Guid(filteratt.G)
py_deslect = GhPythonScript(trigger=list_2)  # -> out
# ---------- py_deslect: Python ----------
import rhinoscriptsyntax as rs
import Rhino
import System

doc = Rhino.RhinoDoc.ActiveDoc
doc.Objects.UnselectAll()

print True
# ---------- end py_deslect ----------
txt = Text(id)
py_select = GhPythonScript(id_list=txt, trigger=py_deslect)  # -> out, a
# ---------- py_select: Python ----------
import rhinoscriptsyntax as rs
import Rhino
import System

doc = Rhino.RhinoDoc.ActiveDoc
separate_lines = id_list.split('\n')

for str_id in separate_lines:
    obj_id = System.Guid(str_id)
    rhobj = doc.Objects.Find(obj_id)
    rhobj.Select(True)
# ---------- end py_select ----------
