# Grasshopper definition ABG_201210_AlBahar2.gh (Grasshopper 1.0.7)
# plug-ins: Rhino.Inside for Autodesk Revit

path = FilePath("C:\Users\Gavin\Desktop\AUS_NSW.Sydney.947670_IWEC.epw")
importepw = Ladybug_ImportEpw(epwFile=path)  # -> readMe, latitude, location, dryBulbTemperature, dewPointTemperature, relativeHumidity, windSpeed, windDirection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; plug-in component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
block_sun = BooleanToggle(False)
model = ModelCategoriesPicker({"Air Systems": -2001008, "Air Terminals": -2008013, "Analysis Display Style": -2000304, "Analysis Results": -2000303, "Areas": -2003200, "Bridge Abutments": -2006130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}, selected="Generic Models": -2000151)
ladybug = Ladybug_Ladybug()  # -> Vviiiiiiiiiizzz; plug-in component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
elementtype_picker = ElementTypePicker(
    model,
    {"Al bahar panel : Typical": "8fd1b523-8e55-4511-af8c-b03ee8e07ca0-e66bbb3f-8c43-49fd-8a47-027e2a6e29ba-00035f2f", "Model Text : 600mm Arial": "8fd1b523-8e55-4511-af8c-b03ee8e07ca0-2d99307a-66cd-4439-b173-5c88d252416e-00001ea8"}, selected="Al bahar panel : Typical")
typefltr = TypeFilter(Types=elementtype_picker, Inverted=False)
elements = QueryElements(Filter=typefltr, Limit="200")  # -> Elements, Count
sunpath = Ladybug_SunPath(
    location=importepw.location,
    hour=Slider(9, range=9..16),
    day=Slider(15, range=1..30),
    month=Slider(6, range=1..12),
    timeStep=1,
    dailyOrAnnualSunPath=True)  # -> readMe, sunVectors, sunAltitudes, sunAzimuths, port, sunSpheresMesh, sunPathCrvs, compassCrvs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; plug-in component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
location = ElementLocation(Element=elements.Elements)  # -> Element, Location, Hand, Facing, WorkPlane
rev = Reverse(Vector=sunpath.sunVectors)
devec = DeconstructVector(Vector=rev)  # -> XComponent, YComponent, ZComponent
devec_2 = DeconstructVector(Vector=location.Facing)  # -> XComponent, YComponent, ZComponent
vec = VectorXYZ(XComponent=devec.XComponent, YComponent=devec.YComponent, ZComponent=0)  # -> Vector, Length
vec_2 = VectorXYZ(XComponent=devec_2.XComponent, YComponent=devec_2.YComponent, ZComponent=0)  # -> Vector, Length
angle = Angle(VectorA=vec_2.Vector, VectorB=vec.Vector)  # -> Angle, Reflex
line = LineSDL(Start=location.Location, Direction=rev, Length="5000")  # disabled
dom = ConstructDomain(DomainStart="0", DomainEnd="1")
dom_2 = ConstructDomain(DomainStart="1", DomainEnd="0")
bnd = Bounds(Numbers=angle.Angle)
filter = StreamFilter(Gate=block_sun, Stream0=dom, Stream1=dom_2)
remap = RemapNumbers(Value=angle.Angle, Source=bnd, Target=filter)  # -> Mapped, Clipped
item = ListItem(List=elements.Elements, Index=0, Wrap=True)
item_2 = ListItem(List=remap.Mapped, Index=0, Wrap=True)
setpara = SetElementParameter(Element=elements.Elements, ParameterKey="Open factor", ParameterValue=remap.Mapped)
setpara_2 = SetElementParameter(Element=item, ParameterKey="Open factor", ParameterValue=item_2)  # disabled
