# Grasshopper definition ABG_210318_ClosestGrid.gh (Grasshopper 1.0.7)
# plug-ins: Rhino.Inside for Autodesk Revit

categories = QueryCategories(Type="Annotation", Parent=null, Name="Grids")
catfltr = CategoryFilter(Categories=categories, Inverted=False)
number_slider = Slider(2935, range=0..10000)
elements = QueryElements(Filter=catfltr)  # -> Elements, Count
location = ElementCurve(Element=elements.Elements)  # -> Element, Curve
ext = ExtendCurve(Curve=location.Curve, Type=0, Start=number_slider, End=number_slider)
elemname = ElementName(Element=location.Element)  # -> Element, Name
categories_2 = QueryCategories(Type=1, Parent=null, Name="Furniture")
mcx = MultipleCurves(Curves=ext)  # -> Points, IndexA, IndexB, ParamA, ParamB
catfltr_2 = CategoryFilter(Categories=categories_2, Inverted=False)
elements_2 = QueryElements(Filter=catfltr_2)  # -> Elements, Count
item = ListItem(List=elemname.Name, Index=mcx.IndexA, Wrap=True)
item_2 = ListItem(List=elemname.Name, Index=mcx.IndexB, Wrap=True)
location_2 = ElementLocation(Element=elements_2.Elements)  # -> Element, Location, Hand, Facing, WorkPlane
concat = Concatenate(FragmentA=item_2, FragmentB=item)
pdecon = Deconstruct(Point=location_2.Location)  # -> XComponent, YComponent, ZComponent
pt = ConstructPoint(XCoordinate=pdecon.XComponent, YCoordinate=pdecon.YComponent, ZCoordinate=0)
cp = ClosestPoint(Point=pt, Cloud=mcx.Points)  # -> ClosestPoint, CPIndex, Distance
item_3 = ListItem(List=concat, Index=cp.CPIndex, Wrap=True)
filter = StreamFilter(Gate=Button(), Stream1=item_3)
setparam = SetElementParameter(Element=elements_2.Elements, ParameterKey="Comments", ParameterValue=filter)
