# Grasshopper definition ABG_210531_Speckle.gh (Grasshopper 1.0.7)
# plug-ins: Speckle 2

list = Accounts(
    {"No account selected": , "Account (gcrump@bimguru.com.au | https://speckle.xyz)": "35d41a8684"}, selected="Account (gcrump@bimguru.com.au | https://speckle.xyz)",
    selectedId="35d41a8684",
    selectedServer="https://speckle.xyz")
without_geometry_objects = Panel("https://speckle.xyz/streams/262ebe3fac")
with_geometry_objects = Panel("https://speckle.xyz/streams/47de40eb13")
sget = StreamGet(StreamIDURL=without_geometry_objects, Account=list)
receive = Receive(
    Stream=sget,
    AutoReceive=False,
    CurrentComponentState="up_to_date",
    KitName="Objects",
    LastInfoMessage="Gavin Crump @ 2021-05-31T00:38:47.697Z: Testing 1 (id:50bcf18c86)",
    ReceivedCommitId="50bcf18c86",
    ReceivedObjectId="4dd401a06cdc7d317e2050ec9ae53ab9",
    StreamWrapper="https://speckle.xyz/streams/262ebe3fac?u=35d41a8684")  # -> Data, Info
panel = Panel(receive.Data)
