# Grasshopper definition ABG_210830_Formwork1.gh (Grasshopper 1.0.7)
# Copyright: 2021
# plug-ins: Rhino.Inside for Autodesk Revit, Ironbug.LBHB_Legacy, EleFront

categories = QueryCategories(Type=1, Parent=null)
value_picker = ValuePicker(categories)
falsestart = Ladybug_FalseStartToggle(True)
filter = StreamFilter(Gate=falsestart, Stream1=value_picker)
catfltr = CategoryFilter(Categories=filter, Inverted=False)
elements = QueryElements(Filter=catfltr)  # -> flatten(Elements), Count
geometry = ElementGeometry(Elements=elements.Elements)
param = ElementParameter(Element=elements.Elements, Parameter="Id")  # -> Element, Value
elemcat = ElementCategory(Element=elements.Elements)  # -> Element, Category
brep = Brep(geometry)
layer = DefineLayer(Name=elemcat.Category)
clean = CleanTree(RemoveNulls=True, RemoveInvalid=True, RemoveEmpty=False, Tree=brep)
sunion = SolidUnion(Breps=graft(clean))  # -> flatten(Result)
attributes = DefineObjectAttributes(Name=param.Value, Layer=layer)
bake = Button()
bake_2 = BakeObjects(Geometry=sunion, Attributes=attributes, BakeName="Formwork analysis", Bake=bake)
