# Grasshopper definition ABG_210902_Formwork2.gh (Grasshopper 1.0.7)
# Copyright: 2021
# plug-ins: EleFront

list = ValueList({"Point": 0, "Curve": 1, "Arc": 2, "Circle": 3, "Ellipse": 4, "Line": 5, "Polyline": 6, "Surface": 7, "Brep": 8, "Mesh": 9, "Polysurface": 10, "Block": 11, "Text": 12, "TextDot": 13, "Dimension": 14, "LinearDimension": 15, "AngularDimension": 16, "Hatch": 17, "Leader": 18}, selected="Brep")
list_2 = ValueList({"All solids", "Default", "Floors", "Structural Columns", "Structural Framing", "Walls"}, selected="All solids")
reftype = ReferenceByType(ObjectType=list)  # disabled
reflay = ReferenceByLayer(LayerName=list_2)
sunion = SolidUnion(Breps=reftype)
debrep = DeconstructBrep(Brep=reflay)  # -> Faces, Edges, Vertices
pt = ConstructPoint(XCoordinate="0.5", YCoordinate="0.5", ZCoordinate=0)
evalsrf = EvaluateSurface(Surface=reparameterize(debrep.Faces), Point=pt)  # -> Point, Normal, UDirection, VDirection, Frame
devec = DeconstructVector(Vector=evalsrf.Normal)  # -> XComponent, YComponent, ZComponent
smaller = SmallerThan(FirstNumber=devec.ZComponent, SecondNumber="0.1")  # -> SmallerThan, OrEqualTo
cull = CullPattern(List=debrep.Faces, CullPattern=smaller.SmallerThan)
preview = CustomPreview(Geometry=cull, Material=ColourSwatch(SwatchColor=RGB(143, 148, 150)))
