# Grasshopper definition ABG_210902_Formwork3.gh (Grasshopper 1.0.7)
# Copyright: 2021
# plug-ins: EleFront, Rhino.Inside for Autodesk Revit

list = ValueList({"All solids", "Default", "Floors", "Formwork shell", "Structural Columns", "Structural Framing", "Walls"}, selected="Formwork shell")
list_2 = ValueList({"All solids", "Default", "Floors", "Formwork shell", "Structural Columns", "Structural Framing", "Walls"}, selected=["Floors", "Structural Columns", "Structural Framing", "Walls"])
reflay = ReferenceByLayer(LayerName=list_2)  # -> flatten(Geometry)
reflay_2 = ReferenceByLayer(LayerName=list)
area = Area(Geometry=reflay_2)  # -> Area, Centroid
colom = CollisionOneMany(Collider=area.Centroid, Obstacles=reflay)  # -> Collision, Index
cset = CreateSet(List=colom.Index)  # -> Set, Map
mindex = MemberIndex(Set=colom.Index, Member=graft(cset.Set))  # -> Index, Count
item = ListItem(List=reflay, Index=flatten(cset.Set), Wrap=True)
item_2 = ListItem(List=area.Area, Index=mindex.Index, Wrap=True)
ma = MassAddition(Input=item_2)  # -> flatten(Result), PartialResults
rhatt = GetRhinoAttributes(Geometry=item)  # -> Name, Layer, Color
element = QueryElement(Id=rhatt.Name)
filter = StreamFilter(Gate=Button(), Stream1=element)
param = ElementParameter(Element=filter, Parameter="Formwork area", Value=ma.Result)  # -> Element, Value
