# Grasshopper definition ABG_221019_DominoCarbon.gh (Grasshopper 1.0.7)

# ---- group: Rates (plug in what you need)
concrete_carbon_rate_kg_m3 = Panel("410")
steel_carbon_rate_kg_m3 = Panel("762")

# ---- group: Properties of design
landing_depth = Slider(1.5, range=1..1.8)
f2f = Slider(3, range=3..5)
floors = Slider(2, range=2..10)
max_span = Slider(6, range=3..6)
width = Slider(12, range=5..25)
depth = Slider(6, range=5..25)

# ---- group: General geometric algorithms
division = Division(A=width, B=max_span)
division_2 = Division(A=depth, B=max_span)
dom = ConstructDomain(DomainStart=expr("X*-0.5", width), DomainEnd=expr("X*0.5", width))
dom_2 = ConstructDomain(DomainStart=expr("X*-0.5", depth), DomainEnd=expr("X*0.5", depth))
round = Round(Number=division)  # -> Nearest, Floor, Ceiling
round_2 = Round(Number=division_2)  # -> Nearest, Floor, Ceiling
range = Range(Domain=dom, Steps=round.Ceiling)
range_2 = Range(Domain=dom_2, Steps=round_2.Ceiling)
rectangle = Rectangle(Plane=PlaneXY(0, 0, 0), XSize=dom, YSize=dom_2, Radius=0)  # -> Rectangle, Length
multiplication = Multiplication(A=f2f, B="-0.5")
crossref = CrossReference(ListA=range, ListB=range_2, CrossMode=1)  # -> ListA, ListB
multiplication_2 = Multiplication(A=f2f, B=floors)
abs = Absolute(Value=multiplication)
pt = ConstructPoint(XCoordinate=crossref.ListA, YCoordinate=crossref.ListB, ZCoordinate=0)
srf = Surface(rectangle.Rectangle)
dom_3 = ConstructDomain(DomainStart=0, DomainEnd=multiplication_2)
range_3 = Range(Domain=dom_3, Steps=floors)
Z = UnitZ(Factor=range_3)
partition = PartitionList(List=pt, Size=expr("x+1", round.Ceiling))
line = LineSDL(Start=pt, Direction=Vector(0, 0, 1), Length=multiplication_2)
flip = FlipMatrix(Data=partition)
move = Move(Geometry=srf, Motion=Z)  # -> Geometry, Transform
pt_2 = ConstructPoint(XCoordinate="1", YCoordinate="0.5", ZCoordinate=0)
evalsrf = EvaluateSurface(Surface=reparameterize(srf), Point=pt_2)  # -> Point, Normal, UDirection, VDirection, Frame
fline = FitLine(Points=partition)
fline_2 = FitLine(Points=flip)
merge = Merge(Data1=fline, Data2=fline_2)  # -> flatten(Result)
Z_2 = UnitZ(Factor=f2f)
Y = UnitY(Factor=abs)
move_2 = Move(Geometry=merge, Motion=graft(Z))  # -> flatten(Geometry), Transform
rev = Reverse(Vector=Y)
addition = Addition(A=Y, B=Z_2)
move_3 = Move(Geometry=evalsrf.Point, Motion=addition)  # -> Geometry, Transform
move_4 = Move(Geometry=evalsrf.Point, Motion=rev)  # -> Geometry, Transform
line_2 = LineSDL(Start=move_4.Geometry, Direction=rev, Length=landing_depth)
line_3 = LineSDL(Start=move_3.Geometry, Direction=Y, Length=landing_depth)
ln = Line(StartPoint=move_4.Geometry, EndPoint=move_3.Geometry)
merge_2 = Merge(Data1=line_2, Data2=ln, Data3=line_3)
X = UnitX(Factor=landing_depth)
extr = Extrude(Base=merge_2, Direction=X)
cull_i = CullIndex(List=Z, Indices="-1", Wrap=True)
join = BrepJoin(Breps=extr)  # -> Breps, Closed
move_5 = Move(Geometry=join.Breps, Motion=cull_i)  # -> Geometry, Transform

# ---- group: Slabs/columns/stairs/beams
data = Data(move.Geometry)
data_2 = Data(line)
data_3 = Data(move_5.Geometry)
data_4 = Data(move_2.Geometry)

# ---- group: Beam volume (m3)
profile_m2_beam_minus_floor_overlap = Panel(".3")
steel_proportion = Panel(".30")
multiplication_3 = Multiplication(A=data_4, B=profile_m2_beam_minus_floor_overlap)
len = Length(Curve=data_4)
multiplication_4 = Multiplication(A=len, B=multiplication_3)
subtraction = Subtraction(A="1", B=steel_proportion)
ma = MassAddition(Input=multiplication_4)  # -> Result, PartialResults
multiplication_5 = Multiplication(A=ma.Result, B=steel_proportion)
multiplication_6 = Multiplication(A=ma.Result, B=subtraction)
data_5 = Data(multiplication_6)
data_6 = Data(multiplication_5)

# ---- group: Column volume (m3)
profile_m2_column = Panel(".5")
steel_proportion_2 = Panel(".30")
multiplication_7 = Multiplication(A=data_2, B=profile_m2_column)
len_2 = Length(Curve=data_2)
multiplication_8 = Multiplication(A=len_2, B=multiplication_7)
ma_2 = MassAddition(Input=multiplication_8)  # -> Result, PartialResults
subtraction_2 = Subtraction(A="1", B=steel_proportion_2)
multiplication_9 = Multiplication(A=ma_2.Result, B=steel_proportion_2)
multiplication_10 = Multiplication(A=ma_2.Result, B=subtraction_2)
data_7 = Data(multiplication_10)
data_8 = Data(multiplication_9)

# ---- group: Stair volumes (concrete/steel)
stair_thickness_m_slab_average = Panel(".3")
steel_proportion_3 = Panel(".30")
area = Area(Geometry=data_3)  # -> Area, Centroid
multiplication_11 = Multiplication(A=area.Area, B=stair_thickness_m_slab_average)
subtraction_3 = Subtraction(A="1", B=steel_proportion_3)
ma_3 = MassAddition(Input=multiplication_11)  # -> Result, PartialResults
multiplication_12 = Multiplication(A=ma_3.Result, B=steel_proportion_3)
multiplication_13 = Multiplication(A=ma_3.Result, B=subtraction_3)
data_9 = Data(multiplication_13)
data_10 = Data(multiplication_12)

# ---- group: Slab volumes (concrete/steel)
floor_thickness_m_slab_average = Panel(".22")
steel_proportion_4 = Panel(".15")
area_2 = Area(Geometry=data)  # -> Area, Centroid
multiplication_14 = Multiplication(A=area_2.Area, B=floor_thickness_m_slab_average)
subtraction_4 = Subtraction(A="1", B=steel_proportion_4)
ma_4 = MassAddition(Input=multiplication_14)  # -> Result, PartialResults
multiplication_15 = Multiplication(A=ma_4.Result, B=steel_proportion_4)
multiplication_16 = Multiplication(A=ma_4.Result, B=subtraction_4)
data_11 = Data(multiplication_16)
data_12 = Data(multiplication_15)

# ---- group: Preview
merge_3 = Merge(Data1=data, Data2=data_3)  # -> flatten(Result)
preview = CustomPreview(Geometry=merge_3, Material=ColourSwatch(SwatchColor=RGBA(128, 128, 128, 225)))

merge_4 = Merge(Data1=data_2, Data2=data_4)  # -> flatten(Result)
preview_2 = CustomPreview(Geometry=merge_4, Material=ColourSwatch(SwatchColor=RGB(0, 0, 0)))

# ---- group: Volume concrete/steel
ma_5 = MassAddition(Input=flatten([data_11, data_9, data_7, data_5]))  # -> Result, PartialResults
ma_6 = MassAddition(Input=flatten([data_12, data_10, data_8, data_6]))  # -> Result, PartialResults

# ---- group: Sum of total carbon (t)
multiplication_17 = Multiplication(A=ma_5.Result, B=concrete_carbon_rate_kg_m3)
multiplication_18 = Multiplication(A=ma_6.Result, B=steel_carbon_rate_kg_m3)
division_3 = Division(A=flatten([multiplication_17, multiplication_18]), B="1000")
ma_7 = MassAddition(Input=division_3)  # -> Result, PartialResults
round_3 = Round(Number=ma_7.Result)  # -> Nearest, Floor, Ceiling

# ----
total_carbon_t = Panel(round_3.Nearest)
data_13 = Data(total_carbon_t)

# ---- group: Properties of design (continued)
total_carbon_t_2 = Panel(data_13)
