# Grasshopper definition ABG_230303_AttractorArray.gh (Grasshopper 1.0.7)

# ---- group: Cell grid
tile_size = Slider(6, range=1..10)
array_size = Slider(7, range=2..29)
dom = ConstructDomain(DomainStart=0, DomainEnd=tile_size)
rectangle = Rectangle(Plane=PlaneXY(0, 0, 0), XSize=dom, YSize=dom, Radius=0)  # -> Rectangle, Length
arrrec = RectangularArray(Geometry=rectangle.Rectangle, Cell=rectangle.Rectangle, XCount=array_size, YCount=array_size)  # -> Geometry, Transform

# ----
md_slider = MDSlider(
    SliderMode=0,
    slider_value=Point(0.6672031277, 0.7465898467, 0.5),
    x_domain=Domain(0, 1),
    y_domain=Domain(0, 1),
    z_domain=Domain(0, 1))
md_slider_2 = MDSlider(
    SliderMode=0,
    slider_value=Point(0.2530101734, 0.3395690918, 0.5),
    x_domain=Domain(0, 1),
    y_domain=Domain(0, 1),
    z_domain=Domain(0, 1))
max_height = Slider(22, range=1..25)
invert = BooleanToggle(True)

# ---- group: Cells and centroids
area = Area(Geometry=arrrec.Geometry)  # -> Area, Centroid
bbox = BoundingBox(Content=arrrec.Geometry, Plane=PlaneXY(0, 0, 0), UnionBox=True)  # -> Box, Box_2
srf = Surface(bbox.Box)

# ----
evalsrf = EvaluateSurface(Surface=reparameterize(srf), Point=md_slider_2)  # -> Point, Normal, UDirection, VDirection, Frame
evalsrf_2 = EvaluateSurface(Surface=reparameterize(srf), Point=md_slider)  # -> Point, Normal, UDirection, VDirection, Frame

# ---- group: Measure attraction
dist = Distance(PointA=area.Centroid, PointB=evalsrf.Point)
dist_2 = Distance(PointA=area.Centroid, PointB=evalsrf_2.Point)
min = Minimum(A=dist, B=dist_2)
panel = Panel("0.99")
bnd = Bounds(Numbers=min)
dom_2 = ConstructDomain(DomainStart="0.01", DomainEnd=panel)
remap = RemapNumbers(Value=min, Source=bnd, Target=dom_2)  # -> Mapped, Clipped
subtraction = Subtraction(A="1", B=remap.Mapped)
filter = StreamFilter(Gate=invert, Stream0=subtraction, Stream1=remap.Mapped)

# ----
division = Division(A=max_height, B=panel)

# ---- group: Measure attraction (continued)
multiplication = Multiplication(A=filter, B=division)
Z = UnitZ(Factor=multiplication)

# ---- group: Preview result
extr = Extrude(Base=arrrec.Geometry, Direction=Z)
cap = CapHoles(Brep=extr)
preview = CustomPreview(Geometry=cap, Material=ColourSwatch(SwatchColor=RGB(128, 121, 255)))
