# Grasshopper definition ABG_230313_TwistedTower.gh (Grasshopper 1.0.7)

# ---- group: Make tower shape
width_depth = Slider(15, range=10..25)
height = Slider(36, range=10..40)
dom = ConstructDomain(DomainStart=expr("-0.5 * x", width_depth), DomainEnd=expr("0.5 * x", width_depth))
cluster = Cluster(data=height)
rectangle = Rectangle(Plane=PlaneXY(0, 0, 0), XSize=dom, YSize=dom, Radius=0)  # -> Rectangle, Length
Z = UnitZ(Factor=cluster)
move = Move(Geometry=rectangle.Rectangle, Motion=Z)  # -> Geometry, Transform
angle = Slider(42, range=0..90)
cluster_2 = Cluster(data=angle)
rotate = Rotate(Geometry=move.Geometry, Angle=degrees(cluster_2), Plane=PlaneXY(0, 0, 0))  # -> Geometry, Transform
merge = Merge(Data1=rectangle.Rectangle, Data2=rotate.Geometry)  # -> flatten(Result)
loft = Loft(Curves=merge, Options={Adjust=False, Closed=False, LoftEnds=0, LoftSimp=0, LoftType=0, Rebuild=10, Refit=0.01})
cap = CapHoles(Brep=loft)

# ---- group: Level heights
f2f = Slider(3.5, range=3..5)
division = Division(A=height, B=f2f)
round = Round(Number=division)  # -> Nearest, Floor, Ceiling
multiplication = Multiplication(A=f2f, B=round.Floor)
dom_2 = ConstructDomain(DomainStart=0, DomainEnd=multiplication)
range = Range(Domain=dom_2, Steps=round.Floor)
pt = ConstructPoint(XCoordinate=0, YCoordinate=0, ZCoordinate=range)

# ---- group: Cluster
data = Data()
division_2 = Division(A=data, B="2")
merge_2 = Merge(Data1=division_2, Data2=data)
R = Result(merge_2)

# ---- group: Measure area
contour = Contour(Shape=cap, Point=Point(0, 0, 0), Direction=Vector(0, 0, 1), Distance="3.5")  # -> flatten(Contours)
srf = Surface(contour)
area = Area(Geometry=srf)  # -> Area, Centroid
ma = MassAddition(Input=area.Area)  # -> Result, PartialResults
panel = Panel(ma.Result)

# ==== cluster Cluster
data = ClusterInput()
data_2 = Data(data)
division = Division(A=data_2, B="2")
merge = Merge(Data1=division, Data2=data_2)
R = ClusterOutput(merge)
